# Grasshopper definition ABM_GA_1.0.gh (Grasshopper 1.0.8)

trigger = Trigger(Interval=20, TimerInterval=20, Target=c_script)  # disabled
c_script = CSharpScript(Reset=Button())  # -> out, A, B, PopHealth; inputs Reset: Boolean
# ---------- c_script: C# ----------
// Grasshopper Script Instance
#region Usings
using System;
using System.Linq;
using System.Collections;
using System.Collections.Generic;
using System.Drawing;

using Rhino;
using Rhino.Geometry;

using Grasshopper;
using Grasshopper.Kernel;
using Grasshopper.Kernel.Data;
using Grasshopper.Kernel.Types;
#endregion

public class Script_Instance : GH_ScriptInstance
{
    #region Notes
    /* 
      Members:
        RhinoDoc RhinoDocument
        GH_Document GrasshopperDocument
        IGH_Component Component
        int Iteration

      Methods (Virtual & overridable):
        Print(string text)
        Print(string format, params object[] args)
        Reflect(object obj)
        Reflect(object obj, string method_name)
    */
    #endregion

    private void RunScript(
		bool Reset,
		ref object A,
		ref object B,
		ref object PopHealth)
    {
        if(Reset){
       sandbox = new TrainingEnvironment(-EnvBounds, EnvBounds, 50, 10);
    }
    sandbox.Train();
    A = sandbox.DisplayCollectables();
    B = sandbox.DisplayAgents();
    PopHealth = sandbox.population.CurrentHealth();
    }
      public static TrainingEnvironment sandbox;
  public static Random rnd = new Random();
  public static int EnvBounds = 30;
  public static double MutationRate = 0.3;
  public class Population
  {
    public SmartAgent[] Agents;
    public List<double> average;
    public List<double> min;
    public List<double> max;
    public List<SmartAgent> best;

    public Population(int size)
    {
      average = new List<double>();
      min = new List<double>();
      max = new List<double>();

      Agents = new SmartAgent[size];
      for (int i = 0; i < Agents.Length; i++)
      {
        Agents[i] = new SmartAgent();
      }
      best = new List<SmartAgent>();
    }

    public List<Curve> Display()
    {
      return Agents.Select(x => x.Display()).ToList();
    }

    public void Update(List<ICollectable> collectables)
    {
      List<Curve> observations = new List<Curve>();
      foreach (var p in Agents)
      {
        p.Update(collectables);
      }
    }

    public void Breed()
    {
      Agents = Agents.OrderBy(x => x.Health).ToArray();
      CalcStats();
      best.Add(Agents.Last());
      var newPop = new List<SmartAgent>();
      // Elite
      for (int i = Agents.Length - 1; i >= Agents.Length / 2; i--)
      {
        newPop.Add(Agents[i]);
        Agents[i].Reset();
      }

      for (int i = 0; i < Agents.Length / 2; i++)
      {
        var agentA = Agents[Select()];
        var agentB = Agents[Select()];

        var breed = agentA.BreedAgent(agentB);

        newPop.Add(breed);
      }

      Agents = newPop.ToArray();
    }

    private void CalcStats()
    {
      var eval = Agents.Select(x => x.Health);
      min.Add(eval.Min());
      max.Add(eval.Max());
      average.Add(eval.Average());
    }

    public double[] CurrentHealth()
    {
      return Agents.Select(x => x.Health).ToArray();
    }

    public int Select()
    {
      int which = (int) Math.Floor(Agents.Length * (1.0 - Math.Pow((rnd.NextDouble()), 2)));
      return which;
    }

  }
  ////-------------------
  public class TrainingEnvironment
  {
    public List<ICollectable> Collectables;
    public Population population;
    int numOfFood;
    int populationSize;
    int min, max;
    int generation;
    int counter;
    public TrainingEnvironment(int min, int max, int numOfFood, int populationSize)
    {
      this.numOfFood = numOfFood;
      this.populationSize = populationSize;
      this.min = min;
      this.max = max;
      Reset();
    }
    void Reset()
    {
      ResetCollectables();
      ResetPopulation();
    }
    void ResetCollectables()
    {
      Collectables = new List<ICollectable>();
      for (int i = 0; i < numOfFood; i++)
      {
        Collectables.Add(new Food(new Point3d(RandomDoubleInRange(min, max), RandomDoubleInRange(min, max), 0)));
      }
    }
    void ResetPopulation()
    {
      population = new Population(populationSize);
      generation = 0;
      counter = 0;
    }
    public void Train()
    {
      this.population.Update(this.Collectables);
      counter++;
      if(counter > 100)
      {
        ResetCollectables();
        counter = 0;
        this.population.Breed();
        generation++;
      }
    }
    public void Test(bool Reset = false)
    {
      if (Reset)
      {
        ResetCollectables();
      }
      else if (population.best.Count > 0)
      {
        var best = population.best.Last();
        best.Update(Collectables);
      }
      else return;
    }
    public List<Curve> DisplayCollectables()
    {
      return Collectables.Where(x => !x.isCollected).Select(x => x.Display()).ToList();
    }
    public List<Curve> DisplayAgents()
    {
      return population.Display();
    }
  }
  //---------------------------------------
  public enum Collectables{
   Food, Enemies, Poison
  }
  public interface ICollector{
    double Health {get;}
    void Collect(ICollectable collectable);
  }
  public interface ICollectable{
    double Worth {get;}
    Point3d GetLocation();
    Collectables GetCollectableType();
    Curve Display();
    bool isCollected {get;}
    double Collect();
  }
  public class Food : ICollectable{
    Point3d Location;
    public Food(Point3d p){
      this.Location = p;
    }
    public double Worth {get{return 10;}}

    public Point3d GetLocation(){
      return this.Location;
    }
    public Collectables GetCollectableType(){
      return Collectables.Food;
    }
    public Curve Display(){
      return new Circle(new Plane(Location, Vector3d.ZAxis), 0.5).ToNurbsCurve();
    }
    public bool isCollected {get; private set;}
    public double Collect(){
      isCollected = true;
      return this.Worth;
    }
  }
//  public class Poison : ICollectable {
//
//  }
  public class SmartAgent : ICollector{
    Agent Agent;
    Network Brain;
    double size = 1;
    double MaxObsDist = EnvBounds * 2;
    double MinObsDist = 0.5;
    public double Health{get; private set;}
    public SmartAgent(){
      Reset();
    }
    public SmartAgent(Point3d pos, Vector3d dir, double fov, int res){
      this.Health = 100;
      this.Agent = new Agent(pos, dir, fov, res);
    }
    public void Reset(){
      this.Health = 100;
      var pos = new Point3d(RandomDoubleInRange(-EnvBounds, EnvBounds), RandomDoubleInRange(-EnvBounds, EnvBounds), 0);
      var dir = new Vector3d(RandomDoubleInRange(-EnvBounds, EnvBounds), RandomDoubleInRange(-EnvBounds, EnvBounds), 0);
      this.Agent = new Agent(pos, dir, 90, 50);
      var detail = this.Agent.isovist.Count;
      this.Brain = new Network(new[]{detail, (int) detail/2, 1});
    }
    public void Update(List<ICollectable> collectables){
      var observationDetails = this.Agent.Observe(collectables.Select(x => x.Display()).ToList());
      var BrainInput = observationDetails.Select(x => {
        var value = x.distance;
        var clampMin = Math.Max(value, MinObsDist);
        var clamped = Math.Min(clampMin, MaxObsDist);
        return ((clamped - MinObsDist) / (MaxObsDist - MinObsDist)) * 2 - 1;
        }).ToArray();

      var response = this.Brain.Respond(BrainInput);

      Collect(collectables);

      if (this.Health < 0)
      {
        return;
      }
      this.Health--;

      this.Agent.Update(response[0]);
    }
    public void Collect(List<ICollectable> collectables){
      var myPos = this.Agent.position;
      var possibilities = new PointCloud(collectables.Select(x => x.GetLocation()));
      var id = possibilities.ClosestPoint(myPos);
      if (id != -1)
      {
        var collectable = collectables[id];
        var distance = collectable.GetLocation().DistanceTo(myPos);
        if (distance < 2)
        {
          this.Collect(collectable);
        }
      }
    }
    public void Collect(ICollectable collectable){
      Health += collectable.Collect();
    }
    public Curve Display(){
     return new Circle(new Plane(this.Agent.position, Vector3d.ZAxis), size).ToNurbsCurve();
    }
    public SmartAgent BreedAgent(SmartAgent other)
    {
      var newAgent = new SmartAgent();
      newAgent.Brain = Breed(other.Brain, this.Brain);
      return newAgent;
    }
  }
  public class Agent{
    double fov;
    int res;
    public Point3d position;
    public Vector3d dir;
    public List<RayHit> latestHits;
    public RayHit favoredHit;
    RayHit leastFavored;
    public List<Vector3d> isovist;

    public Agent(Point3d pos, Vector3d dir, double fov, int res){
      latestHits = new List<RayHit>();
      favoredHit = new RayHit(){Hit = Point3d.Unset,distance = -1};
      this.position = pos;
      this.dir = dir;
      this.fov = fov;
      this.res = res;
      dir.Unitize();
      isovist = Isovist(this.dir, this.fov, this.res);
    }

    public void Update(double steerValue){
      var vecRight = Vector3d.CrossProduct(this.dir, Vector3d.ZAxis) * steerValue;
      var desired = this.dir - vecRight;
      this.dir += desired;
      this.dir.Unitize();
      position += dir;
    }
    public List<RayHit> Observe(List<Curve> context){
      isovist = Isovist(this.dir, this.fov, this.res);
      latestHits = isovist.Select(x => RayCast(this.position, x, context)).ToList();
      return latestHits;
    }
  }

  public static RayHit RayCast(Point3d P, Vector3d dir, List<Curve> Context){
    var intersections = Context.Select((c, idx) => RayCurveIntersection(P, dir, c, idx)).ToList();
    var closest = intersections.Where(x => x.Hit != Point3d.Unset);
    if(closest.Count() > 0){
      var c = closest.OrderBy(x => P.DistanceTo(x.Hit))
        .First();
      return c;
    }
    return new RayHit(){Hit = Point3d.Unset,distance = -1, HitIndex = -1};
  }

  public static RayHit RayCurveIntersection(Point3d P, Vector3d dir, Curve Crv, int index){
    var ray = new Line(P, dir, 999999).ToNurbsCurve();
    var intersectionEvents = Rhino.Geometry.Intersect.Intersection.CurveCurve(Crv, ray, 0.01, 0.01);
    var points = new List<Point3d>();
    if(intersectionEvents.Count > 0){
      foreach (var ccevent in intersectionEvents)
      {
        points.Add(ccevent.PointA);
      }
      var closest = points.OrderBy(x => P.DistanceTo(x)).First();
      return new RayHit(){Hit = closest,distance = P.DistanceTo(closest), HitIndex = index};
    }
    return new RayHit(){Hit = Point3d.Unset,distance = -1, HitIndex = -1};
  }

  public class RayHit{
    public Point3d Hit;
    public double distance;
    public int HitIndex;
  }

  public static List<Vector3d> Isovist(Vector3d dir, double fov, int res){
    var vectors = new List<Vector3d>();
    if(fov != 0){
      var step = fov / (res * 1.0);
      var half = fov / 2.0;
      for(double i = -half; i < half + 0.0001; i += step)
      {
        var temp = new Vector3d(dir);
        temp.Rotate(RhinoMath.ToRadians(i), Vector3d.ZAxis);
        vectors.Add(temp);
      }
    }
    return vectors;
  }

  public static Network Breed(Network a, Network b)
  {
    Network child = new Network(a.Structure);
    var numOfLayers = a.Structure.Length;
    for (int i = 1; i < numOfLayers; i++)
    {
      var layerA = a.Layers[i];
      var layerB = b.Layers[i];
      var childLayer = child.Layers[i];
      var numOfNeurons = layerA.Length;
      var mid = rnd.Next(0, numOfNeurons);
      for (int j = 0; j < numOfNeurons; j++)
      {
        if(j < mid)
        {
          childLayer[j].m_weights = layerA[j].m_weights;
          childLayer[j].m_threshold = layerA[j].m_threshold;
        }
        else
        {
          childLayer[j].m_weights = layerB[j].m_weights;
          childLayer[j].m_threshold = layerB[j].m_threshold;
        }
        if (rnd.NextDouble() < MutationRate)
        {
          childLayer[j].m_weights = Enumerable.Range(0, childLayer[j].m_weights.Length)
            .Select(x => RandomDoubleInRange(-1, 1)).ToArray();
          childLayer[j].m_threshold = RandomDoubleInRange(-1, 1);
        }
      }
    }
    return child;
  }
  public class Network
  {
    public List<Neuron []> Layers;
    public int[] Structure;


    public Network(int[] Structure)
    {
      this.Structure = Structure;

      Layers = new List<Neuron []>();
      var structureLen = Structure.Length;

      if(structureLen > 2){
        for (int i = 0; i < structureLen; i++)
        {
          var numOfneurons = Structure[i];

          var temp = new Neuron[numOfneurons];
          if(i == 0){
            for (int j = 0; j < numOfneurons; j++)
            {
              temp[j] = new Neuron();
            }
          }
          else{
            for (int j = 0; j < numOfneurons; j++)
            {
              temp[j] = new Neuron(Layers[i - 1]);
            }
          }
          Layers.Add(temp);
        }
      }
    }

    public double[] Respond(double [] inputs)
    {
      double [] responses = new double [Layers.Last().Length];

      var layersCount = Layers.Count;

      for (int i = 0; i < layersCount; i++)
      {
        var layer = Layers[i];
        var numOfneurons = layer.Length;
        if(i == 0){
          for (int j = 0; j < numOfneurons; j++)
          {
            layer[j].m_output = inputs[j];
          }
        }
        else if (i == layersCount - 1){
          for (int j = 0; j < numOfneurons; j++)
          {
            responses[j] = layer[j].Respond();
          }
        }
        else{
          for (int j = 0; j < numOfneurons; j++)
          {
            layer[j].Respond();
          }
        }

      }
      return responses;
    }
  }
  public class Neuron
  {
    public Neuron [] m_inputs;
    public double [] m_weights;
    public double m_threshold;
    public double m_output;
    public double m_error;

    // the input layer of neurons have no inputs:
    public Neuron()
    {
      m_threshold = 0.0;
      m_error = 0.0;
      m_output = Activation.Output(RandomDoubleInRange(-1, 1));
    }
    // all other layers (hidden and output) have neural inputs
    public Neuron(Neuron [] inputs)
    {
      m_inputs = new Neuron [inputs.Length];
      m_weights = new double [inputs.Length];
      for (int i = 0; i < inputs.Length; i++) {
        m_inputs[i] = inputs[i];
        m_weights[i] = RandomDoubleInRange(-1, 1);
      }
      m_threshold = RandomDoubleInRange(-1, 1);
      m_output = Activation.Output(RandomDoubleInRange(-1, 1));
    }

    // respond looks at the layer below, and prepares a response:
    public double Respond()
    {
      double input = 0.0;
      for (int i = 0; i < m_inputs.Length; i++) {
        input += m_inputs[i].m_output * m_weights[i];
      }
      m_output = Activation.Output(input + m_threshold);
      return m_output;
    }
  }
  private static double RandomDoubleInRange(double minNumber, double maxNumber){
    return rnd.NextDouble() * (maxNumber - minNumber) + minNumber;
  }
  private static double RandomDoubleInRange(int minNumber, int maxNumber){
    return rnd.NextDouble() * (maxNumber - minNumber) + minNumber;
  }
  public static class Activation
  {
    public static double[] Tanh;

    static Activation(){
      double[] temp = new double[200];
      for (int i = 0; i < 200; i++) {
        var z = (i / 20.0) - 5.0;
        temp[i] = (2.0 / (1.0 + Math.Exp(-2.0 * z)) - 1.0);
      }
      Tanh = temp;
    }
    public static double Output(double x)
    {
      var val = (int) ((x + 1.0) * 100.0);
      if(val < 0) val = 0;
      if(val > 199) val = 199;
      return Tanh[val];
    }
  }

}
# ---------- end c_script ----------
sort = SortList(Keys=c_script.PopHealth, ValuesA=c_script.B)  # -> Keys, ValuesA
srf = Surface(reverse(sort.ValuesA))
item = ListItem(List=srf, Index=0, Wrap=True)
graph = QuickGraph(sort.Keys, SortOrder=0)
panel = Panel(c_script.A)
panel_2 = Panel(c_script.B)
